# Dynamo graph C3D_DrawSection.dyn (Dynamo 2.4.1.6394)

CONCRETE = TBMDesigner.Domain.SleeperType.CONCRETE()

# group: Input
track_alignment_data_excel_file = StringInput("D:\_PROJECTs\60654007 Track Recon Stanwell Park\60654007 CDA centrelines at 1m intervals.xlsx")  # "Track alignment data excel file path"; graph input
sheet_tab_name = StringInput("Down Tunnel")  # graph input
project_base_point_easting = DoubleInput(297500)
project_base_point_northing = DoubleInput(1210600)
code_block = CodeBlock(sleeper=CONCRETE) { sleeper; }
railcorp_specifation_json_path = StringInput("C:\Users\linp3\Source\Repos\peggylin-hub\TBMDesigner\TBMDesignerFunctions\Resources\RailcorpSpecs.json")  # graph input
index_of_track_type = DoubleSlider(1, range=0..6 step 1)  # graph input
vehicle_data_specification_json = StringInput("C:\Users\linp3\Source\Repos\peggylin-hub\TBMDesigner\TBMDesignerFunctions\Resources\VehicleData.json")  # "Vehicle Data Specification Json Path"; graph input
index_of_vehicle_type = DoubleSlider(7, range=0..16 step 1)  # graph input
sat_file_location = Directory("D:\_PROJECTs\60654007 Track Recon Stanwell Park")

file_from_path = FileObject(path=track_alignment_data_excel_file)
importExcel = Data.ImportExcel(file=file_from_path, sheetName=sheet_tab_name)
code_block_2 = CodeBlock(ls=importExcel)
# ---------- code_block_2.designscript (3 lines) ----------
//remove the table title
newls=List.DropItems(ls,1);
List.Transpose(newls);
# ----------------------------------------
code_block_3 = CodeBlock(ls=code_block_2.out1, x0=project_base_point_easting, y0=project_base_point_northing) { ch=ls[0]; x=ls[1]-x0; y=ls[2]-y0; z=ls[3]; r=ls[4]; curveType=ls[5]; curveSide=ls[6]; e=ls[7]; }
trackSpecification = TBMDesigner.Dynamo.KinematicEnvelopeCalculation.TrackSpecification(SpecJsonFilePath=railcorp_specifation_json_path)
getItemAtIndex = List.GetItemAtIndex(list=trackSpecification, index=index_of_track_type)
vechicleTypeList = TBMDesigner.Dynamo.KinematicEnvelopeCalculation.VechicleTypeList(VechicleJsonFilePath=vehicle_data_specification_json)
getItemAtIndex_2 = List.GetItemAtIndex(list=vechicleTypeList, index=index_of_vehicle_type)
kinematicEnvelope = TBMDesigner.Dynamo.KinematicEnvelopeCalculation.KinematicEnvelope(curveTypes=code_block_3.curveType, curveRadiuses=code_block_3.r, superElevations=code_block_3.e, curveSides=code_block_3.curveSide, sleeperType=code_block, SpecificationName=getItemAtIndex, vehicleType=getItemAtIndex_2, VechileDataFilePath=vehicle_data_specification_json, SpecificationPath=railcorp_specifation_json_path)
code_block_4 = CodeBlock(ls=kinematicEnvelope.KE0_Static) { newls=List.Transpose(ls); x=newls[0]/1000; y=newls[1]/1000; pts=Point.ByCoordinates(x,y); }
create_polylines = Python(IN[0]=code_block_4.pts)
# ---------- create_polylines.python (17 lines) ----------
# Load the Python Standard and DesignScript Libraries
import sys
import clr
clr.AddReference('ProtoGeometry')
from Autodesk.DesignScript.Geometry import *

# The inputs to this node will be stored as a list in the IN variables.
points = IN[0]

# Place your code below this line

# Assign your output to the OUT variable.
OUT = []

for pts in points:
	pt = Point.PruneDuplicates(pts)
	OUT.append( PolyCurve.ByPoints(pt, True))
# ----------------------------------------
code_block_5 = CodeBlock { origin=Point.ByCoordinates(0,0,0); }
XAxis = Vector.XAxis()
reverse = Vector.Reverse(vector=XAxis)
ZAxis = Vector.ZAxis()
YAxis = Vector.YAxis()
byOriginVectors = CoordinateSystem.ByOriginVectors(origin=code_block_5, xAxis=reverse, yAxis=ZAxis, zAxis=YAxis)
code_block_6 = CodeBlock(x=code_block_3.x, y=code_block_3.y, z=code_block_3.z)
# ---------- code_block_6.designscript (4 lines) ----------
pts=Point.ByCoordinates(x,y,z);
pl=PolyCurve.ByPoints(pts);
pa=PolyCurve.ParameterAtPoint(pl, pts);
co=PolyCurve.CoordinateSystemAtParameter(pl, pa);
# ----------------------------------------
transform = Geometry.Transform(geometry=create_polylines, fromCoordinateSystem=byOriginVectors, contextCoordinateSystem=code_block_6.co)
python_script = Python(IN[0]=transform)
# ---------- python_script.python (18 lines) ----------
# Load the Python Standard and DesignScript Libraries
import sys
import clr
clr.AddReference('ProtoGeometry')
from Autodesk.DesignScript.Geometry import *

# The inputs to this node will be stored as a list in the IN variables.
data = IN[0]

# Place your code below this line

# Assign your output to the OUT variable.
OUT = []

for i in range(0, len(data)-1):
	d1 = data[i]
	d2 = data[i + 1]
	OUT.append([d1,d2])
# ----------------------------------------
code_block_7 = CodeBlock(ls=python_script) { i1=List.GetItemAtIndex(ls,0); i2=List.GetItemAtIndex(ls,1); i3=List.GetItemAtIndex(ls,2); [i1,i2,i3]; }
SLAB_TRACK = TBMDesigner.Domain.SleeperType.SLAB_TRACK()
WOODEN = TBMDesigner.Domain.SleeperType.WOODEN()

# group: Create Solid
byLoft = Solid.ByLoft(crossSections=python_script)

translate = Geometry.Translate(geometry=byLoft, xTranslation=project_base_point_easting, yTranslation=project_base_point_northing)

# group: get AutoCAD information and create layer
current = Autodesk.AutoCAD.DynamoNodes.Document.Current()
create = Autodesk.AutoCAD.DynamoNodes.Layer.Create(name=getItemAtIndex_2, document=current)
code_block_8 = CodeBlock(layer=create) { layer.Name; }
blocks = Autodesk.AutoCAD.DynamoNodes.Document.Blocks(document=current)
code_block_9 = CodeBlock(ls=blocks)
# ---------- code_block_9.designscript (2 lines) ----------
//get model space
ls[0];
# ----------------------------------------
currentLayer = Autodesk.AutoCAD.DynamoNodes.Document.CurrentLayer(document=current)

# group: Import Geometry to AutoCAD
byGeometry = Autodesk.AutoCAD.DynamoNodes.Object.ByGeometry(geometry=translate, layer=code_block_8, block=code_block_9)  # frozen

directory_from_path = DirectoryObject(path=sat_file_location)
code_block_10 = CodeBlock(dir=directory_from_path, railName=sheet_tab_name, envelopeName=getItemAtIndex_2) { dir+"\\"+railName+"_"+envelopeName+".sat"; }
exportToSAT = ExportWithUnits(geometry=translate, filePath=code_block_10, SelectedExportedUnitsSource=[0, 1, 2, 3, 5, 4], SelectedExportedUnit=5)
